# Grasshopper definition keycaps.gh (Grasshopper 1.0.7)

pipeline = GeometryPipeline(
    GroupByLayer=False,
    GroupByType=False,
    IncludeHidden=True,
    IncludeLocked=True,
    LayerFilter="Keycaps::R4",
    NameFilter="*",
    SublayerFiltering=True,
    TypeFilter=4)
pipeline_2 = GeometryPipeline(
    GroupByLayer=False,
    GroupByType=False,
    IncludeHidden=True,
    IncludeLocked=True,
    LayerFilter="Keycaps::R3",
    NameFilter="*",
    SublayerFiltering=True,
    TypeFilter=4)
pipeline_3 = GeometryPipeline(
    GroupByLayer=False,
    GroupByType=False,
    IncludeHidden=True,
    IncludeLocked=True,
    LayerFilter="Keycaps::R2",
    NameFilter="*",
    SublayerFiltering=True,
    TypeFilter=4)
pipeline_4 = GeometryPipeline(
    GroupByLayer=False,
    GroupByType=False,
    IncludeHidden=True,
    IncludeLocked=True,
    LayerFilter="Keycaps::R1",
    NameFilter="*",
    SublayerFiltering=True,
    TypeFilter=4)
long = LongestList(ListA=flatten(pipeline_4), ListB="R1", PaddingMode=2)  # -> ListA, ListB
long_2 = LongestList(ListA=flatten(pipeline_3), ListB="R2", PaddingMode=2)  # -> ListA, ListB
long_3 = LongestList(ListA=flatten(pipeline_2), ListB="R3", PaddingMode=2)  # -> ListA, ListB
long_4 = LongestList(ListA=flatten(pipeline), ListB="R4", PaddingMode=2)  # -> ListA, ListB
merge = Merge(Data1=long.ListA, Data2=long_2.ListA, Data3=long_3.ListA, Data4=long_4.ListA)
merge_2 = Merge(Data1=long.ListB, Data2=long_2.ListB, Data3=long_3.ListB, Data4=long_4.ListB)
disc = Discontinuity(Curve=merge, Level=1)  # -> Points, Parameters
item = ListItem(List=disc.Points, Index=0, Wrap=True)
item_2 = ListItem(List=disc.Points, Index=1, Wrap=True)
item_3 = ListItem(List=disc.Points, Index=2, Wrap=True)
subtraction = Subtraction(A=item_2, B=item)
subtraction_2 = Subtraction(A=item_3, B=item_2)
pl = ConstructPlane(Origin=item, XAxis=subtraction, YAxis=subtraction_2)
vlen = VectorLength(Vector=subtraction)
vlen_2 = VectorLength(Vector=subtraction_2)
pshift = ShiftPaths(Data=pl, Offset=-1)
pshift_2 = ShiftPaths(Data=vlen, Offset=-1)
pshift_3 = ShiftPaths(Data=vlen_2, Offset=-1)
row = Text(merge_2)

# ----
# Keycap Data
panel = Panel("""R1,9.8,9.8
R2,7.8,7.3
R3,7.2,6.2
R4,8.6,6.2""")
split = TextSplit(Text=panel, Separators=",")
item_4 = ListItem(List=split, Index=1, Wrap=True)  # -> flatten(Item)
item_5 = ListItem(List=split, Index=2, Wrap=True)  # -> flatten(Item)
item_6 = ListItem(List=split, Index=0, Wrap=True)  # -> flatten(Item)
data = Data(item_6)
data_2 = Data(item_4)
data_3 = Data(item_5)
keysearch = KeyValueSearch(Keys=data, Values=data_2, Search=row)
keysearch_2 = KeyValueSearch(Keys=data, Values=data_3, Search=row)

pln = Plane(pshift)
width = Number(pshift_2)
height = Number(pshift_3)
key_base_plane = Plane(pln)
y_size_mm = Data(height)
x_size_mm = Data(width)

# ----
# Size Label
key_base_plane_2 = Plane(key_base_plane)
x_size_mm_2 = Data(x_size_mm)
number_slider = Slider(2, range=0..10)
division = Division(A=x_size_mm_2, B=19.05)
format = Format(Format="{0:#.00}", Culture=127, Data0=division)
larger = LargerThan(FirstNumber=division, SecondNumber=1.01)  # -> LargerThan, OrEqualTo
vec = VectorXYZ(XComponent=number_slider, YComponent=number_slider, ZComponent=0)  # -> Vector, Length
long_5 = LongestList(ListA=format, PaddingMode=2)  # -> ListA, ListB
int = Integer(larger.LargerThan)
move = Move(Geometry=key_base_plane_2, Motion=vec.Vector)  # -> Geometry, Transform
p_n_c = PickNChoose(Pattern=int, Stream0=long_5.ListB, Stream1=long_5.ListA)
tag = TextTag3D(Location=move.Geometry, Text=p_n_c, Size=Slider(4, range=0..10), Justification=7)

# ----
# Top Rect
base_offset_mm = Data(Slider(0.5, range=0..1))
y_size_mm_2 = Data(y_size_mm)
x_offset_mm = Data(Slider(3, range=0..10))
y_upper_offset_mm = Data(Slider(0.5, range=0..1))
y_lower_offset_mm = Data(Slider(4, range=0..10))
z_upper = Data(keysearch)
z_lower = Data(keysearch_2)
x_size_mm_3 = Data(x_size_mm)
addition = Addition(A=base_offset_mm, B=x_offset_mm)
addition_2 = Addition(A=base_offset_mm, B=y_upper_offset_mm)
addition_3 = Addition(A=base_offset_mm, B=y_lower_offset_mm)
subtraction_3 = Subtraction(A=y_size_mm_2, B=addition_2)
subtraction_4 = Subtraction(A=x_size_mm_3, B=addition)
c_script = CSharpScript(x0=addition, x1=subtraction_4, y0=addition_3, y1=subtraction_3, z0=z_upper, z1=z_lower)  # -> out, A; inputs x0: Double, x1: Double, y0: Double, y1: Double, z0: Double, z1: Double
# ---------- c_script: C# ----------
var pline = new Polyline();

pline.Add(x0, y0, z0);
pline.Add(x1, y0, z0);
pline.Add(x1, y1, z1);
pline.Add(x0, y1, z1);
pline.Add(x0, y0, z0);

A = pline;
# ---------- end c_script ----------

# ----
# Bottom Rect
y_size_mm_3 = Data(y_size_mm)
base_offset_mm_2 = Data(Slider(0.5, range=0..1))
x_size_mm_4 = Data(x_size_mm)

subtraction_5 = Subtraction(A=x_size_mm_4, B=base_offset_mm_2)
subtraction_6 = Subtraction(A=y_size_mm_3, B=base_offset_mm_2)

c_script_2 = CSharpScript(x0=base_offset_mm_2, x1=subtraction_5, y0=base_offset_mm_2, y1=subtraction_6, z0=0, z1=0)  # -> out, A; inputs x0: Double, x1: Double, y0: Double, y1: Double, z0: Double, z1: Double; same code as c_script

# ----
# Construct Keycap Body
top_radius = Data(Slider(1.5, range=0..10))
bottom_rect = Data(c_script_2.A)
bottom_radius = Data(Slider(0.5, range=0..10))
top_rect = Data(c_script.A)
fillet = Fillet(Curve=bottom_rect, Radius=bottom_radius)
fillet_2 = Fillet(Curve=top_rect, Radius=top_radius)
explode = Explode(Curve=fillet, Recursive=True)  # -> Segments, Vertices
explode_2 = Explode(Curve=fillet_2, Recursive=True)  # -> Segments, Vertices
rulesrf = RuledSurface(CurveA=explode.Segments, CurveB=explode_2.Segments)
join = BrepJoin(Breps=rulesrf)  # -> Breps, Closed
cap = CapHoles(Brep=join.Breps)

# ----
# Top Face Cutter
top_rect_2 = Data(c_script.A)
Z = Data(Slider(0.5, range=0..1))
neg = Negative(Value=Z)
multiplication = Multiplication(A=Z, B=2)
c_script_3 = CSharpScript(pl=top_rect_2, z=neg)  # -> out, A, B; inputs pl: Polyline, z: Double
# ---------- c_script_3: C# ----------
var segments = pl.GetSegments();
var plane = new Plane(segments[0].From, segments[0].To-segments[0].From, segments[1].To-segments[1].From);

Point3d midPoint = (Point3d)(segments[0].To - segments[0].From)*0.5;
midPoint.Transform(Transform.Translation(new Vector3d(0, 0, z)));

var arc = new Arc(
    Point3d.Origin,
    midPoint,
    (Point3d)(segments[0].To-segments[0].From)
);
arc.Transform(Transform.PlaneToPlane(Plane.WorldXY, plane));

A = arc;
B = plane;
# ---------- end c_script_3 ----------
bbox = BoundingBox(Content=graft(top_rect_2), Plane=graft(c_script_3.B), UnionBox=True)  # -> Box, Box_2
deplane = DeconstructPlane(Plane=c_script_3.B)  # -> Origin, XAxis, YAxis, ZAxis
multiplication_2 = Multiplication(A=deplane.ZAxis, B=multiplication)

pshift_4 = ShiftPaths(Data=bbox.Box, Offset=-1)

debox = DeconstructBox(Box=pshift_4)  # -> Plane, X, Y, Z
dedomain = DeconstructDomain(Domain=debox.Y)  # -> Start, End
subtraction_7 = Subtraction(A=dedomain.End, B=dedomain.Start)
multiplication_3 = Multiplication(A=deplane.YAxis, B=subtraction_7)
move_2 = Move(Geometry=c_script_3.A, Motion=expr("x*-0.5", multiplication_3))  # -> Geometry, Transform
multiplication_4 = Multiplication(A=multiplication_3, B=2)
extr = Extrude(Base=move_2.Geometry, Direction=multiplication_4)
extr_2 = Extrude(Base=extr, Direction=multiplication_2)  # -> graft(Extrusion)

sdiff = SolidDifference(BrepsA=cap, BrepsB=extr_2)

orient = Orient(Geometry=sdiff, Source=PlaneXY(0, 0, 0), Target=graft(key_base_plane))  # -> Geometry, Transform
material = CreateMaterial(
    Diffuse=ColourSwatch(SwatchColor=RGB(143, 149, 178)),
    Specular=ColourSwatch(SwatchColor=RGB(153, 115, 38)),
    Emission=ColourSwatch(SwatchColor=RGB(0, 0, 0)),
    Transparency=Slider(0.25, range=0..1),
    Shine=Slider(5, range=0..100))
preview = CustomPreview(Geometry=orient.Geometry, Material=material)
